# Grasshopper definition TestDocument2.gh (Grasshopper 1.0.7)
# plug-ins: CityJson

panel = Panel("C:\development\CityJSON\TestData\3dbag_v210908_fd2cee53_5881.json")
# Example: Import + Export of BAG file
construct_assembly = ConstructAssembly(Filename=panel)
deconstruct_document = DeconstructDocument(Document=construct_assembly)  # -> Object, LOD, Reference, Transform
deconstruct_cityobject = DeconstructCityObject(CityObject=deconstruct_document.Object)  # -> Id, Lod, Type, Geometry, Address, AddressLocation, Children, Parents, AttributeKeys, AttributeValues
deconstruct_citygeometry = DeconstructCityGeometry(CityGeometry=deconstruct_cityobject.Geometry)  # -> Id, Lod, Type, Solid, MultiSurface, Mesh
construct_citygeometry = ConstructCityGeometry(
    Id=deconstruct_citygeometry.Id,
    Lod=deconstruct_citygeometry.Lod,
    Type=deconstruct_citygeometry.Type,
    Solid=deconstruct_citygeometry.Solid,
    MultiSurface=deconstruct_citygeometry.MultiSurface)
construct_cityobject = ConstructCityObject(
    Id=graft(deconstruct_cityobject.Id),
    Lod=graft(deconstruct_cityobject.Lod),
    Type=graft(deconstruct_cityobject.Type),
    Geometry=construct_citygeometry,
    Children=deconstruct_cityobject.Children,
    Parents=deconstruct_cityobject.Parents,
    AttributeKeys=deconstruct_cityobject.AttributeKeys,
    AttributeValues=deconstruct_cityobject.AttributeValues)
trim_tree = TrimTree(Tree=construct_cityobject, Depth=1)
construct_document = ConstructDocument(Object=trim_tree)
save_cityjson_file = SaveCityJsonFile(Document=construct_document, Filename="c:\temp\test.json")
